# Grasshopper definition robotic_brick_laying_es.ghx (Grasshopper 1.0.7)

geo = Geometry([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])
python = GhPythonScript()  # -> out, surfaces, meshes, planes; disabled
# ---------- python: Python ----------
from compas_rhino import unload_modules
unload_modules('model')

from model import Brick
from model import Fabrication
import Rhino.Geometry as rg

plane = rg.Plane(rg.Point3d(0,0,100), rg.Vector3d.XAxis, rg.Vector3d.YAxis)

myFirstBrick = Brick(plane)

mesh = myFirstBrick.mesh()
surfaces= myFirstBrick.surface()
pick_plane = myFirstBrick.picking_plane()



meshes = []
planes = []

for i in range(10):
    for j in range(20):
            if i % 2 == 1:
                x_value = (Brick.REFERENCE_LENGTH * j) + 1 * j + Brick.REFERENCE_LENGTH/2
                z_value = (Brick.REFERENCE_HEIGHT * i) + 1 * i
                
                plane_origin = rg.Point3d(x_value, 0, z_value)
                plane = rg.Plane(plane_origin, rg.Vector3d.XAxis, rg.Vector3d.YAxis)
                
            else : 
                x_value = (Brick.REFERENCE_LENGTH * j) + 1 * j 
                z_value = (Brick.REFERENCE_HEIGHT * i) + 1 * i
                
                plane_origin = rg.Point3d(x_value, 0, z_value)
                plane = rg.Plane(plane_origin, rg.Vector3d.XAxis, rg.Vector3d.YAxis)
                
            myBrick = Brick(plane)
            planes.append(myBrick.picking_plane())
            meshes.append(myBrick.mesh())
# ---------- end python ----------
crv = Curve([<curve referenced from the Rhino model> x2])
pt = Point(<point referenced from the Rhino model>)
bricks = GhPythonScript(robot_base_geometry=geo)  # -> out, surfaces, planes, robot_crv, transformed_robot_base; inputs robot_base_geometry: list of Brep; disabled
# ---------- bricks: Python ----------
from compas_rhino import unload_modules
unload_modules('model')

from model import Wall
from model import Fabrication
import Rhino.Geometry as rg



myWall = Wall(5,10)
surfaces, visualisation, robot_transformation = myWall.geometric_model()
#script, visualisation_robot_coordinate_system = myWall.fabrication_model()
#print(type(robot_transformation))
#planes, robot_crv = visualisation_robot_coordinate_system


#print (script)
transformed_robot_base = []
for geometry in robot_base_geometry:
    trans_geometry = geometry.Duplicate()
    trans_geometry.Transform(robot_transformation)
    transformed_robot_base.append(trans_geometry)
# ---------- end bricks ----------
python_2 = GhPythonScript(curves=crv)  # -> out, brick_planes, planes; inputs curves: list of Curve; disabled
# ---------- python_2: Python ----------
import rhinoscriptsyntax as rs
import Rhino.Geometry as rg
import math as m



def curve2bricks():
    brick_planes=[]
    normal = rg.Vector3d.ZAxis
    for curve in curves:
        params = rg.Curve.DivideByLength(curve, 25+1,False)
        for param in params:
            brick_pos = rg.Curve.PointAt(curve, param)
            brick_tan = rg.Curve.TangentAt(curve, param)
            vec1 = rg.Vector3d.CrossProduct(brick_tan, normal)
            vec2 = rg.Vector3d.CrossProduct(vec1, normal)
            plane = rg.Plane(brick_pos, vec1, vec2)
            brick_planes.append(plane)
            print (plane.ZAxis)
    return brick_planes
    
brick_planes = curve2bricks()
# ---------- end python_2 ----------
python_3 = GhPythonScript(x=pt)  # -> out, meshes, planes; inputs curves: list of Curve
# ---------- python_3: Python ----------
from compas_rhino import unload_modules
unload_modules('model')

from model import Brick
from model import Fabrication
import Rhino.Geometry as rg
import math as m

plane = rg.Plane(rg.Point3d(0,0,100), rg.Vector3d.XAxis, rg.Vector3d.YAxis)

myFirstBrick = Brick(plane)

mesh = myFirstBrick.mesh()
surfaces= myFirstBrick.surface()
pick_plane = myFirstBrick.picking_plane()



meshes = []
planes = []

#for i in range(10):
#    for j in range(20):
#            if i % 2 == 1:
#                x_value = (Brick.REFERENCE_LENGTH * j) + 1 * j + Brick.REFERENCE_LENGTH/2
#                z_value = (Brick.REFERENCE_HEIGHT * i) + 1 * i
#               
#                plane_origin = rg.Point3d(x_value, 0, z_value)
#                plane = rg.Plane(plane_origin, rg.Vector3d.XAxis, rg.Vector3d.YAxis)
#                
#            else : 
#                x_value = (Brick.REFERENCE_LENGTH * j) + 1 * j 
#                z_value = (Brick.REFERENCE_HEIGHT * i) + 1 * i
#                
#                plane_origin = rg.Point3d(x_value, 0, z_value)
#                plane = rg.Plane(plane_origin, rg.Vector3d.XAxis, rg.Vector3d.YAxis)
#                
#            myBrick = Brick(plane)
#            planes.append(myBrick.picking_plane())
#            meshes.append(myBrick.mesh())

for i in range(10):
    for j in range(20):
            if i % 2 == 1:
                x_value = ((Brick.REFERENCE_LENGTH + Brick.REFERENCE_WIDTH)/2) * j
                z_value = (Brick.REFERENCE_HEIGHT * i) + 1 * i
                
                plane_origin = rg.Point3d(x_value, 0, z_value)
                plane = rg.Plane(plane_origin, rg.Vector3d.XAxis, rg.Vector3d.YAxis)
#                values = rg.Point3d.DistanceTo(gh_point, plane.Origin)
                 
                if j % 2 == 1:
                    rg.Plane.Rotate(plane, m.radians(90),plane.ZAxis, plane.Origin)
                else:
                    rg.Plane.Rotate(plane, m.radians(45),plane.ZAxis, plane.Origin)
            else : 
                x_value = ((Brick.REFERENCE_LENGTH + Brick.REFERENCE_WIDTH)/2) * j
                z_value = (Brick.REFERENCE_HEIGHT * i) + 1 * i
               
                plane_origin = rg.Point3d(x_value, 0, z_value)
                plane = rg.Plane(plane_origin, rg.Vector3d.XAxis, rg.Vector3d.YAxis)
                if j % 2 == 0:
                    rg.Plane.Rotate(plane, m.radians(90),plane.ZAxis, plane.Origin)
                
            myBrick = Brick(plane)
            planes.append(myBrick.picking_plane())
            meshes.append(myBrick.mesh())


def remapValue(v,ori_Min,ori_Max,targetMin,targetMax):
    rv = ((v-ori_Min)/(ori_Max-ori_Min))*(targetMax-targetMin)+targetMin
    return rv
def remapValues(values, targetMin, targetMax):
    """ Remap numbers into a numeric domain """
    if len(set(values)) >1:
        remappedValues = []
        # Get source domain min and max
        scrMin = min(values)
        scrMax = max(values)
        # Iterate the values and remap them
        for v in values:
            rv = ((v-scrMin)/(scrMax-scrMin))*(targetMax-targetMin)+targetMin
            remappedValues.append(rv)
        return remappedValues
    # Else return targeMax for each values
    else:
        return [targetMax]*len(values)
# ---------- end python_3 ----------
mesh = Mesh(python.meshes)  # disabled
mesh_2 = Mesh(python_3.meshes)
geo_2 = Geometry(bricks.surfaces)
geo_3 = Geometry(bricks.planes)
geo_4 = Geometry(bricks.robot_crv)
geo_5 = Geometry(bricks.transformed_robot_base)
item = ListItem(List=geo_2, Index=Slider(94, range=0..100), Wrap=True)
geo_6 = Geometry(item)
